# Grasshopper definition 3d_iphone_final.gh (Grasshopper 1.0.7)

mesh = Mesh([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])
R = Slider(255, range=0..255)
G = Slider(255, range=0..255)
B = Slider(255, range=0..255)
top_mesh_projected = Mesh(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)
H = Slider(20, range=1..30)
size = Slider(10, range=5..20)
mcol = MeshColours(Mesh=mesh, Colours=ColourSwatch(SwatchColor=RGB(0, 0, 0)))
area = Area(Geometry=top_mesh_projected)  # -> Area, Centroid

# ---- group: RH_OUT:screen
mesh_2 = Mesh(mcol)

# ----
neg = Negative(Value="65")
case_base_mesh = Mesh([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])
blue = GetNumber(B, AtLeast=1, AtMost=1, Maximum=1.797693135e+308, Minimum=-1.797693135e+308)
green = GetNumber(G, AtLeast=1, AtMost=1, Maximum=1.797693135e+308, Minimum=-1.797693135e+308)
red = GetNumber(R, AtLeast=1, AtMost=1, Maximum=1.797693135e+308, Minimum=-1.797693135e+308)
vec = VectorXYZ(XComponent=neg, YComponent=neg, ZComponent=0)  # -> Vector, Length
height = GetNumber(H, AtLeast=1, AtMost=1, Maximum=1.797693135e+308, Minimum=-1.797693135e+308)
make_3d = GetBoolean(Toggle(False), AtLeast=1, AtMost=1, FalseValue="False", TrueValue="True")
size_2 = GetNumber(size, AtLeast=1, AtMost=1, Maximum=1.797693135e+308, Minimum=-1.797693135e+308)
rotation = GetNumber(Slider(5, range=1..179), AtLeast=1, AtMost=1, Maximum=1.797693135e+308, Minimum=-1.797693135e+308)
mesh_3 = Mesh([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])
move = Move(Geometry=area.Centroid, Motion=vec.Vector)  # -> Geometry, Transform
mcol_2 = MeshColours(Mesh=mesh_3, Colours=ColourSwatch(SwatchColor=RGB(255, 255, 255)))
rgb = ColourRGB(Alpha=255, Red=red, Green=green, Blue=blue)
num = Number(height)
xy = XYPlane(Origin=move.Geometry)

# ---- group: RH_OUT:iphone
mesh_4 = Mesh(mcol_2)

# ----
division = Division(A=num, B="10")
rotate = Rotate(Geometry=xy, Angle=degrees(rotation), Plane=PlaneXY(0, 0, 0))  # -> Geometry, Transform
division_2 = Division(A="200", B=size_2)

# ---- group: RH_OUT:base
mcol_3 = MeshColours(Mesh=case_base_mesh, Colours=rgb)

# ----
Z = UnitZ(Factor=division)
mesh_5 = Mesh([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])
trigrid = Triangular(Plane=rotate.Geometry, Size=size_2, ExtentX=division_2, ExtentY=division_2)  # -> Cells, Points
mcol_4 = MeshColours(Mesh=mesh_5, Colours=ColourSwatch(SwatchColor=RGB(135, 135, 135)))
top_surface = Brep(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)

# ---- group: RH_OUT:camera
mesh_6 = Mesh(mcol_4)

# ----
crv = Curve(top_surface)
trim = TrimWithRegion(Curve=trigrid.Cells, Region=crv)  # -> Inside, Outside
crv_2 = Curve(flatten(trim.Inside))
cls = Closed(Curve=crv_2)  # -> Closed, Periodic
cull = CullPattern(List=crv_2, CullPattern=cls.Closed)
crv_3 = Curve(cull)
gate = StreamGate(Stream=crv_3, Gate=make_3d)  # -> Target0, Target1
disc = Discontinuity(Curve=flatten(gate.Target0), Level=1)  # -> simplify(Points), Parameters
area_2 = Area(Geometry=gate.Target0)  # -> Area, Centroid
graft = GraftTree(Tree=area_2.Centroid, IncludeEmptyLists=True, IncludeNullItems=True)  # -> simplify(Tree)
item = ListItem(List=disc.Points, Index=0, Wrap=True)  # -> Item, Item1, Item2
explode = Explode(Curve=flatten(gate.Target0), Recursive=True)  # -> Segments, Vertices
ln = Line(StartPoint=item.Item, EndPoint=graft)
ln_2 = Line(StartPoint=item.Item1, EndPoint=graft)
ln_3 = Line(StartPoint=item.Item2, EndPoint=graft)
number_slider = Slider(0.1, range=0..0.1)
merge = Merge(Data1=explode.Segments, Data2=ln, Data3=ln_2, Data4=ln_3)
offset = OffsetCurve(Curve=flatten(merge), Distance=number_slider, Corners=1)
offset_2 = OffsetCurve(Curve=flatten(merge), Distance=expr("x*-1", number_slider), Corners=1)
loft = Loft(
    Curves=[offset, offset_2],
    Options={Adjust=False, Closed=False, LoftEnds=0, LoftSimp=0, LoftType=0, Rebuild=10, Refit=0.01})  # disabled
rulesrf = RuledSurface(CurveA=offset, CurveB=offset_2)  # -> flatten(Surface)
runion = RegionUnion(Curves=flatten(loft))  # disabled
srf = Surface(runion)  # disabled
area_3 = Area(Geometry=srf)  # -> Area, Centroid; disabled
sort = SortList(Keys=area_3.Area, ValuesA=srf, ValuesB=runion)  # -> Keys, reverse(ValuesA), reverse(ValuesB); disabled
item_2 = ListItem(List=sort.ValuesA, Index=0, Wrap=True)  # disabled
split = SplitList(List=sort.ValuesB, Index=1)  # -> ListA, ListB; disabled
srfsplit = SurfaceSplit(Surface=item_2, Curves=split.ListB)  # disabled
area_4 = Area(Geometry=srfsplit)  # -> Area, Centroid; disabled
sort_2 = SortList(Keys=area_4.Area, ValuesA=srfsplit)  # -> Keys, reverse(ValuesA); disabled
area_5 = Area(Geometry=gate.Target1)  # -> Area, Centroid
vec_2 = Vector(Z)
item_3 = ListItem(List=sort_2.ValuesA, Index=0, Wrap=True)  # disabled
move_2 = Move(Geometry=area_5.Centroid, Motion=vec_2)  # -> flatten(Geometry), Transform
extr = Extrude(Base=item_3, Direction=vec_2)  # disabled
extr_2 = ExtrudePoint(Base=gate.Target1, Point=move_2.Geometry)
extr_3 = Extrude(Base=rulesrf, Direction=vec_2)
R_2 = Slider(255, range=0..255)
G_2 = Slider(255, range=0..255)
B_2 = Slider(255, range=0..255)
mesh_7 = Mesh(extr)  # disabled
mesh_8 = Mesh(extr_2)
mesh_9 = Mesh(extr_3)
blue_top = GetNumber(B_2, AtLeast=1, AtMost=1, Maximum=1.797693135e+308, Minimum=-1.797693135e+308)
green_top = GetNumber(G_2, AtLeast=1, AtMost=1, Maximum=1.797693135e+308, Minimum=-1.797693135e+308)
red_top = GetNumber(R_2, AtLeast=1, AtMost=1, Maximum=1.797693135e+308, Minimum=-1.797693135e+308)
filter = StreamFilter(Gate=make_3d, Stream0=mesh_9, Stream1=mesh_8)
rgb_2 = ColourRGB(Alpha=255, Red=red_top, Green=green_top, Blue=blue_top)

# ---- group: RH_OUT:case
mcol_5 = MeshColours(Mesh=filter, Colours=rgb_2)
