# Grasshopper definition 3d_iphone_case.gh (Grasshopper 1.0.7)

H = Slider(15, range=15..30)
size = Slider(10, range=5..50)
top_mesh = Mesh(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)
case_base_mesh = Mesh([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])
neg = Negative(Value="65")

# ---- group: RH_OUT:iphone
iphone_mesh = Mesh([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])

# ---- group: RH_OUT:base
mcol = MeshColours(Mesh=case_base_mesh, Colours=ColourSwatch(SwatchColor=RGB(161, 200, 255)))

# ----
area = Area(Geometry=top_mesh)  # -> Area, Centroid
vec = VectorXYZ(XComponent=neg, YComponent=neg, ZComponent=0)  # -> Vector, Length
height = GetNumber(H, AtLeast=1, AtMost=1, Maximum=1.797693135e+308, Minimum=-1.797693135e+308)
size_2 = GetNumber(size, AtLeast=1, AtMost=1, Maximum=1.797693135e+308, Minimum=-1.797693135e+308)
move = Move(Geometry=area.Centroid, Motion=vec.Vector)  # -> Geometry, Transform
xy = XYPlane(Origin=move.Geometry)
num = Number(height)
division = Division(A="200", B=size_2)
division_2 = Division(A=num, B="10")
trigrid = Triangular(Plane=xy, Size=size_2, ExtentX=division, ExtentY=division)  # -> Cells, Points
Z = UnitZ(Factor=division_2)
move_2 = Move(Geometry=trigrid.Points, Motion=Z)  # -> flatten(Geometry), Transform
disc = Discontinuity(Curve=flatten(trigrid.Cells), Level=1)  # -> simplify(Points), Parameters
graft = GraftTree(Tree=move_2.Geometry, IncludeEmptyLists=True, IncludeNullItems=True)  # -> simplify(Tree)
item = ListItem(List=disc.Points, Index=0, Wrap=True)  # -> Item, Item1, Item2
explode = Explode(Curve=flatten(trigrid.Cells), Recursive=True)  # -> Segments, Vertices
item_2 = ListItem(List=explode.Segments, Index=0, Wrap=True)  # -> simplify(Item), simplify(Item1), simplify(Item2)
ln = Line(StartPoint=item.Item, EndPoint=graft)
ln_2 = Line(StartPoint=item.Item1, EndPoint=graft)
ln_3 = Line(StartPoint=item.Item2, EndPoint=graft)
boundary = BoundarySurfaces(Edges=[item_2.Item1, ln_2, ln_3])
boundary_2 = BoundarySurfaces(Edges=[ln, ln_2, item_2.Item])
boundary_3 = BoundarySurfaces(Edges=[item_2.Item2, ln, ln_3])
merge = Merge(Data1=boundary_2, Data2=boundary, Data3=boundary_3)  # -> flatten(Result)
top_surface = Brep(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)
join = BrepJoin(Breps=merge)  # -> Breps, Closed
area_2 = Area(Geometry=top_surface)  # -> Area, Centroid
scale = Scale(Geometry=top_surface, Center=area_2.Centroid, Factor=Slider(0.98, range=0..1))  # -> Geometry, Transform
Z_2 = UnitZ(Factor=division_2)
extr = Extrude(Base=scale.Geometry, Direction=Z_2)
crv = Curve(scale.Geometry)
crv_2 = Curve(top_surface)
Z_3 = UnitZ(Factor=division_2)
split = SplitBrep(Brep=join.Breps, Cutter=extr)
loft = Loft(Curves=[crv_2, crv], Options={Adjust=False, Closed=False, LoftEnds=0, LoftSimp=0, LoftType=0, Rebuild=10, Refit=0.01})
area_3 = Area(Geometry=split)  # -> Area, Centroid
extr_2 = Extrude(Base=loft, Direction=Z_3)
sort = SortList(Keys=area_3.Area, ValuesA=split)  # -> Keys, ValuesA
cull_i = CullIndex(List=reverse(sort.ValuesA), Indices=0, Wrap=True)
brep = Brep(cull_i)
join_2 = BrepJoin(Breps=brep)  # -> Breps, Closed

# ---- group: RH_OUT:edge
mesh = Mesh(extr_2)

# ---- group: RH_OUT:geo
mesh_2 = Mesh(join_2.Breps)
