# Grasshopper definition 3d_iphone_final2.gh (Grasshopper 1.0.7)

panel = Panel("#324ea8")
base_color = GetString({"#324ea8"}, selected=[], AtLeast=1, AtMost=1)
mesh = Mesh([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])
top_mesh_projected = Mesh(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)
chars = Characters(Text=base_color)  # -> Result, Unicode
H = Slider(20, range=1..30)
size = Slider(10, range=5..20)
mcol = MeshColours(Mesh=mesh, Colours=ColourSwatch(SwatchColor=RGB(0, 0, 0)))
item = ListItem(List=chars.Result, Index=0, Wrap=True)  # -> Item, Item1, Item2, Item3, Item4, Item5, Item6
area = Area(Geometry=top_mesh_projected)  # -> Area, Centroid

# ---- group: RH_OUT:screen
mesh_2 = Mesh(mcol)

# ----
neg = Negative(Value="65")
case_base_mesh = Mesh([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])
concat = Concatenate(FragmentA=item.Item1, FragmentB=item.Item2)
vec = VectorXYZ(XComponent=neg, YComponent=neg, ZComponent=0)  # -> Vector, Length
concat_2 = Concatenate(FragmentA=item.Item3, FragmentB=item.Item4)
concat_3 = Concatenate(FragmentA=item.Item5, FragmentB=item.Item6)
height = GetNumber(H, AtLeast=1, AtMost=1, Maximum=1.797693135e+308, Minimum=-1.797693135e+308)
make_3d = GetBoolean(Toggle(False), AtLeast=1, AtMost=1, FalseValue="False", TrueValue="True")
size_2 = GetNumber(size, AtLeast=1, AtMost=1, Maximum=1.797693135e+308, Minimum=-1.797693135e+308)
rotation = GetNumber(Slider(5, range=1..179), AtLeast=1, AtMost=1, Maximum=1.797693135e+308, Minimum=-1.797693135e+308)
mesh_3 = Mesh([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])
move = Move(Geometry=area.Centroid, Motion=vec.Vector)  # -> Geometry, Transform
python = GhPythonScript(x=concat, y=concat_2, z=concat_3)  # -> out, a, b, c
# ---------- python: Python ----------
__author__ = "onep9"
__version__ = "2022.03.20"

import rhinoscriptsyntax as rs

a = int(x,16)

b = int(y,16)

c = int(z,16)
# ---------- end python ----------
mcol_2 = MeshColours(Mesh=mesh_3, Colours=ColourSwatch(SwatchColor=RGB(255, 255, 255)))
num = Number(height)
rgb = ColourRGB(Alpha=255, Red=python.a, Green=python.b, Blue=python.c)
xy = XYPlane(Origin=move.Geometry)

# ---- group: RH_OUT:iphone
mesh_4 = Mesh(mcol_2)

# ----
division = Division(A=num, B="10")
rotate = Rotate(Geometry=xy, Angle=degrees(rotation), Plane=PlaneXY(0, 0, 0))  # -> Geometry, Transform
division_2 = Division(A="200", B=size_2)

# ---- group: RH_OUT:base
mcol_3 = MeshColours(Mesh=case_base_mesh, Colours=rgb)

# ----
Z = UnitZ(Factor=division)
mesh_5 = Mesh([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])
trigrid = Triangular(Plane=rotate.Geometry, Size=size_2, ExtentX=division_2, ExtentY=division_2)  # -> Cells, Points
mcol_4 = MeshColours(Mesh=mesh_5, Colours=ColourSwatch(SwatchColor=RGB(135, 135, 135)))
top_surface = Brep(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)

# ---- group: RH_OUT:camera
mesh_6 = Mesh(mcol_4)

# ----
crv = Curve(top_surface)
trim = TrimWithRegion(Curve=trigrid.Cells, Region=crv)  # -> Inside, Outside
crv_2 = Curve(flatten(trim.Inside))
cls = Closed(Curve=crv_2)  # -> Closed, Periodic
cull = CullPattern(List=crv_2, CullPattern=cls.Closed)
crv_3 = Curve(cull)
gate = StreamGate(Stream=crv_3, Gate=make_3d)  # -> Target0, Target1
disc = Discontinuity(Curve=flatten(gate.Target0), Level=1)  # -> simplify(Points), Parameters
area_2 = Area(Geometry=gate.Target0)  # -> Area, Centroid
graft = GraftTree(Tree=area_2.Centroid, IncludeEmptyLists=True, IncludeNullItems=True)  # -> simplify(Tree)
item_2 = ListItem(List=disc.Points, Index=0, Wrap=True)  # -> Item, Item1, Item2
explode = Explode(Curve=flatten(gate.Target0), Recursive=True)  # -> Segments, Vertices
ln = Line(StartPoint=item_2.Item, EndPoint=graft)
ln_2 = Line(StartPoint=item_2.Item1, EndPoint=graft)
ln_3 = Line(StartPoint=item_2.Item2, EndPoint=graft)
number_slider = Slider(0.1, range=0..0.1)
merge = Merge(Data1=explode.Segments, Data2=ln, Data3=ln_2, Data4=ln_3)
offset = OffsetCurve(Curve=flatten(merge), Distance=number_slider, Corners=1)
offset_2 = OffsetCurve(Curve=flatten(merge), Distance=expr("x*-1", number_slider), Corners=1)
loft = Loft(
    Curves=[offset, offset_2],
    Options={Adjust=False, Closed=False, LoftEnds=0, LoftSimp=0, LoftType=0, Rebuild=10, Refit=0.01})
runion = RegionUnion(Curves=flatten(loft))
srf = Surface(runion)
area_3 = Area(Geometry=srf)  # -> Area, Centroid
sort = SortList(Keys=area_3.Area, ValuesA=srf, ValuesB=runion)  # -> Keys, reverse(ValuesA), reverse(ValuesB)
item_3 = ListItem(List=sort.ValuesA, Index=0, Wrap=True)
split = SplitList(List=sort.ValuesB, Index=1)  # -> ListA, ListB
srfsplit = SurfaceSplit(Surface=item_3, Curves=split.ListB)
top_color = GetString("#324ea8", AtLeast=1, AtMost=1)
area_4 = Area(Geometry=srfsplit)  # -> Area, Centroid
sort_2 = SortList(Keys=area_4.Area, ValuesA=srfsplit)  # -> Keys, reverse(ValuesA)
chars_2 = Characters(Text=top_color)  # -> Result, Unicode
area_5 = Area(Geometry=gate.Target1)  # -> Area, Centroid
vec_2 = Vector(Z)
item_4 = ListItem(List=chars_2.Result, Index=0, Wrap=True)  # -> Item, Item1, Item2, Item3, Item4, Item5, Item6
item_5 = ListItem(List=sort_2.ValuesA, Index=0, Wrap=True)
move_2 = Move(Geometry=area_5.Centroid, Motion=vec_2)  # -> flatten(Geometry), Transform
concat_4 = Concatenate(FragmentA=item_4.Item1, FragmentB=item_4.Item2)
concat_5 = Concatenate(FragmentA=item_4.Item3, FragmentB=item_4.Item4)
concat_6 = Concatenate(FragmentA=item_4.Item5, FragmentB=item_4.Item6)
extr = Extrude(Base=item_5, Direction=vec_2)
extr_2 = ExtrudePoint(Base=gate.Target1, Point=move_2.Geometry)
python_2 = GhPythonScript(x=concat_4, y=concat_5, z=concat_6)  # -> out, a, b, c; same code as python
rgb_2 = ColourRGB(Alpha=255, Red=python_2.a, Green=python_2.b, Blue=python_2.c)
mesh_7 = Mesh(extr)
mesh_8 = Mesh(extr_2)
mcol_5 = MeshColours(Mesh=[mesh_7, mesh_8], Colours=rgb_2)

# ---- group: RH_OUT:top
mesh_9 = Mesh(mcol_5)
