# Grasshopper definition studio webapp.gh (Grasshopper 1.0.7)
# plug-ins: Speckle 2, Human

number_slider = Slider(10000, range=0..100000)  # disabled
panel = Panel("https://macad.speckle.xyz/streams/721c474c56/commits/42965874bf")
number_slider_2 = Slider(70, range=0..100)  # disabled
number_slider_3 = Slider(1500, range=0..10000)  # disabled
panel_2 = Panel("https://macad.speckle.xyz/streams/721c474c56/branches/recreation/to_habitat")
qrsettings = QuadRemeshSettings(
    TargetCount=number_slider,
    AdaptiveSize=number_slider_2,
    AdaptiveCount=False,
    HardEdges=True,
    SeamEdges=0,
    Symmetry=0,
    GuideCurves=0)  # disabled
mesh = Mesh()  # disabled
qrmesh = QuadRemesh(Mesh=mesh, Settings=qrsettings)  # disabled
brep = Brep([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])
mesh_2 = Mesh(brep)
mesh_3 = Mesh(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)
receive = Receive(
    Stream=panel,
    AutoReceive=False,
    CurrentComponentState="expired",
    ExpandOutput=True,
    LastInfoMessage="Gerald Mandevhana @ 2022-03-16T11:41:34.386Z: Greenhouse Phase 4 - updated (id:42965874bf)",
    ReceiveOnOpen=False,
    ReceivedCommitId="42965874bf",
    StreamWrapper="https://macad.speckle.xyz/streams/721c474c56/commits/42965874bf",
    selectedKitName="Objects")  # -> Info, Data, ExternalShell, Framing, MatExternalShell, MatFraming, ModifiedCrater, ServiceRails
mjoin = MeshJoin(Meshes=[mesh_2, mesh_3])
receive_2 = Receive(
    Stream=panel_2,
    AutoReceive=False,
    CurrentComponentState="expired",
    ExpandOutput=True,
    LastInfoMessage="Amanda Gioia @ 2022-03-11T18:22:55.425Z: phase4 (id:efb9b2849f)",
    ReceiveOnOpen=False,
    ReceivedCommitId="efb9b2849f",
    StreamWrapper="https://macad.speckle.xyz/streams/721c474c56/branches/recreation/to_habitat",
    selectedKitName="Objects")  # -> Info, Data
geo = Geometry(receive.Framing)
mesh_4 = Mesh(mjoin)
geo_2 = Geometry(receive_2.Data)
rotation = GetNumber(Slider(0, range=0..360), AtLeast=1, AtMost=1, Maximum=1.797693135e+308, Minimum=-1.797693135e+308)
brep_2 = Brep([<brep referenced from the Rhino model> x3])
brep_3 = Brep([<brep referenced from the Rhino model> x8])
brep_4 = Brep([<brep referenced from the Rhino model> x10])
neg = Negative(Value=Slider(20, range=0..100))
vec = Vector(Vector(-2, -20, 23))
neg_2 = Negative(Value=Slider(2, range=0..100))
vec_2 = VectorXYZ(XComponent=neg_2, YComponent=neg, ZComponent=Slider(23, range=0..100))  # -> Vector, Length
rotate = Rotate(Geometry=mesh_4, Angle=degrees(rotation), Plane=PlaneXY(0, 0, 0))  # -> Geometry, Transform
brep_5 = Brep([<brep referenced from the Rhino model> x7])
move = Move(Geometry=brep_5, Motion=vec)  # -> Geometry, Transform
brep_6 = Brep([<brep referenced from the Rhino model> x3])
brep_7 = Brep(move.Geometry)

# ---- group: RH_OUT:crater
crater = Mesh(rotate.Geometry)

# ----
brep_8 = Brep(<brep referenced from the Rhino model>)
brep_9 = Brep([<brep referenced from the Rhino model> x3])
brep_10 = Brep([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])
brep_11 = Brep([<brep referenced from the Rhino model> x3])
brep_12 = Brep([<brep referenced from the Rhino model> x4])
brep_13 = Brep([<brep referenced from the Rhino model> x3])
mesh_5 = Mesh(brep_8)
mesh_6 = Mesh(brep_11)
mesh_7 = Mesh(brep_9)
mesh_8 = Mesh(brep_10)
mesh_9 = Mesh(brep_13)
mesh_10 = Mesh(brep_12)
qrsettings_2 = QuadRemeshSettings(
    TargetCount=Slider(1500, range=0..10000),
    AdaptiveSize=Slider(70, range=0..100),
    AdaptiveCount=False,
    HardEdges=False,
    SeamEdges=0,
    Symmetry=0,
    GuideCurves=0)
qrmesh_2 = QuadRemesh(Mesh=mesh_9, Settings=qrsettings_2)
createlight = CreateLight(Bake=False, Direction=Vector(0, 0, 1), LightStyle="WorldPoint", Intensity=1, Color=RGB(255, 255, 255))
mesh_11 = Mesh(qrmesh_2)
