# Grasshopper definition test_light.gh (Grasshopper 1.0.7)

number_slider = Slider(10, range=0..10)
box = CenterBox(Base=PlaneXY(0, 0, 0), X=number_slider, Y=number_slider, Z=number_slider)
angle = GetNumber(Slider(0, range=0..360), AtLeast=1, AtMost=1, Maximum=1.797693135e+308, Minimum=-1.797693135e+308)
rotate = Rotate(Geometry=box, Angle=degrees(angle), Plane=PlaneXY(0, 0, 0))  # -> Geometry, Transform
brep = Brep(rotate.Geometry)

# ---- group: RH_OUT:geo
mesh = Mesh(brep)
