# Grasshopper definition test_take.gh (Grasshopper 1.0.7)

base_color = GetString("#324ea8", {"#324ea8"}, selected=[], AtLeast=1, AtMost=1)
chars = Characters(Text=base_color)  # -> Result, Unicode
item = ListItem(List=chars.Result, Index=0, Wrap=True)  # -> Item, Item1, Item2, Item3, Item4, Item5, Item6
concat = Concatenate(FragmentA=item.Item1, FragmentB=item.Item2)
concat_2 = Concatenate(FragmentA=item.Item3, FragmentB=item.Item4)
concat_3 = Concatenate(FragmentA=item.Item5, FragmentB=item.Item6)
python = GhPythonScript(x=concat, y=concat_2, z=concat_3)  # -> out, a, b, c
# ---------- python: Python ----------
__author__ = "onep9"
__version__ = "2022.03.20"

import rhinoscriptsyntax as rs

a = int(x,16)

b = int(y,16)

c = int(z,16)
# ---------- end python ----------
sph = Sphere(Base=PlaneXY(0, 0, 0), Radius=1)
rgb = ColourRGB(Alpha=255, Red=python.a, Green=python.b, Blue=python.c)
mesh = Mesh(sph)
mcol = MeshColours(Mesh=sph, Colours=rgb)
c_script = CSharpScript(mesh=mesh, color=rgb)  # -> out, A; inputs mesh: Mesh, color: Color
# ---------- c_script: C# ----------
    var c = color.R + "," + color.G + "," + color.B;
    mesh.SetUserString("color", c);
    A = mesh;
# ---------- c_script: C# additional code ----------
  //Return a BoundingBox that contains all the geometry you are about to draw.
  public override BoundingBox ClippingBox
  {
    get
    {
      return BoundingBox.Empty;
    }
  }

  //Draw all meshes in this method.
  public override void DrawViewportMeshes(IGH_PreviewArgs args)
  {
  }

  //Draw all wires and points in this method.
  public override void DrawViewportWires(IGH_PreviewArgs args)
  {
  }
# ---------- end c_script ----------

# ---- group: RH_OUT:mesh
mesh_2 = Mesh(c_script.A)
